# Dynamo graph DynaMaya w SolarAnalysis.dyn (Dynamo 0.9.0.3067)

get_selected_surface = SelectSurfacehNode()
flatten = Flatten(get_selected_surface)
code_block = CodeBlock()
# ---------- code_block.designscript (5 lines) ----------
cyan=Color.ByARGB(255,0,0,255);
orange=Color.ByARGB(255,255,255,0);
red=Color.ByARGB(255,255,0,0);
colors={cyan,orange,red,red};
indices={0,0.05,0.3,1};
# ----------------------------------------
file_path = Filename("C:\Users\cerve\AppData\Roaming\Dynamo\0.9\packages\Solar Analysis for Dynamo\extra\USA-NewYorkNewYork.wea")
fromFile = DynamoSolarAnalysis.Weather.Weather.FromFile(file_path)
get_selected_surface_2 = SelectSurfacehNode()
get_selected_surface_3 = SelectSurfacehNode()
create = List.Create(get_selected_surface_2, get_selected_surface_3)
flatten_2 = Flatten(create)
date_time = DateTime("June 01, 2015 11:00 AM")
boolean = BoolSelector(true)
still = DynamoSolarAnalysis.Analysis.TimeStudy.Still(date_time, boolean)
number_slider = DoubleSlider(0.5, range=0..100 step 0.1)
number_slider_2 = DoubleSlider(30, range=0..360 step 0.1)
analyze = DynamoSolarAnalysis.Analysis.SolarAnalysis.Analyze(fromFile, flatten, flatten_2, still, number_slider, number_slider_2)
code_block_2 = CodeBlock { 0; 1; }
remapRange = Math.RemapRange(numbers=analyze, newMin=code_block_2.out0, newMax=code_block_2.out1)
color_range = ColorRange(code_block.colors, code_block.indices, remapRange)
bySurfaceColors = Display.Display.BySurfaceColors(flatten, color_range)
