# Dynamo graph MeshOffsetExample.dyn (Dynamo 0.8.2.2392)

get_selected_mesh = SelectMeshNode()
getFaceVerticies = DynaMaya.Nodes.Meshes.MeshNodes.getFaceVerticies(get_selected_mesh.out2)
byPoints = Polygon.ByPoints(getFaceVerticies)
center = Polygon.Center(byPoints)
getFaceNormals = DynaMaya.Nodes.Meshes.MeshNodes.getFaceNormals(get_selected_mesh.out2)
byStartPointDirectionLength = Line.ByStartPointDirectionLength(startPoint=center, direction=getFaceNormals)
code_block = CodeBlock { 1; }
create = List.Create()
flatten = Flatten(byPoints)
byOriginNormal = Plane.ByOriginNormal(origin=center, normal=getFaceNormals)
number_slider = DoubleSlider(0.55, range=0..1 step 0.01)
scale = Geometry.Scale(byPoints, byOriginNormal, number_slider, number_slider, number_slider)
translate = Geometry.Translate(geometry=scale, direction=getFaceNormals)
flatten_2 = Flatten(translate)
combine = List.Combine(create, flatten, flatten_2)
byLoft = Surface.ByLoft(combine)
