# Dynamo graph Simple Mesh Interaction.dyn (Dynamo 1.0.0.473)

get_selected_mesh = SelectMeshNode()
getFaceVerticies = DynaMaya.Nodes.Meshes.MeshNodes.getFaceVerticies(get_selected_mesh.out2)
code_block = CodeBlock { 1; }
byControlPoints = NurbsCurve.ByControlPoints(getFaceVerticies, code_block)
flatten = Flatten(byControlPoints)
controlPoints = NurbsCurve.ControlPoints(flatten)
byPoints = Polygon.ByPoints(getFaceVerticies)
center = Polygon.Center(byPoints)
getFaceNormals = DynaMaya.Nodes.Meshes.MeshNodes.getFaceNormals(get_selected_mesh.out2)
byOriginNormal = Plane.ByOriginNormal(origin=center, normal=getFaceNormals)
number_slider = DoubleSlider(0.5, range=0..1 step 0.1)
scale = Geometry.Scale(byControlPoints, byOriginNormal, number_slider, number_slider, number_slider)
number_slider_2 = DoubleSlider(1.8, range=0..2 step 0.1)
translate = Geometry.Translate(geometry=scale, direction=getFaceNormals, distance=number_slider_2)
flatten_2 = Flatten(translate)
controlPoints_2 = NurbsCurve.ControlPoints(flatten_2)
python_script = Python(IN[0]=controlPoints, IN[1]=controlPoints_2)
# ---------- python_script.python (16 lines) ----------
import clr
clr.AddReference('ProtoGeometry')
from Autodesk.DesignScript.Geometry import *
#The inputs to this node will be stored as a list in the IN variables.
dataEnteringNode = IN

vertsA = IN[0]
vertsB = IN[1]
i=0

for list in vertsA:
	vertsB[i]+=( list)
	i+=1

#Assign your output to the OUT variable.
OUT = vertsB
# ----------------------------------------
code_block_2 = CodeBlock(vert=python_script)
# ---------- code_block_2.designscript (6 lines) ----------
ig1 = IndexGroup.ByIndices(0,1,5,4);
ig2 = IndexGroup.ByIndices(1,2,6,5);
ig3 = IndexGroup.ByIndices(2,3,7,6);
ig4 = IndexGroup.ByIndices(3,0,4,7);
iglist = {ig1,ig2,ig3,ig4};
Mesh.ByPointsFaceIndices(vert, iglist);
# ----------------------------------------
clean = List.Clean(list=code_block_2.out5)
string = StringInput("dynSurfs")
sendGeometry = DynaMaya.Nodes.Interop.Send.SendGeometry(clean, string)
flatten_3 = Flatten()
code_block_3 = CodeBlock { true; }
